# Grasshopper definition handlesGenerator.gh (Grasshopper 1.0.8)
# plug-ins: Pufferfish

geo = Geometry([<extrusion referenced from the Rhino model>, <brep referenced from the Rhino model>, <extrusion referenced from the Rhino model>, <brep referenced from the Rhino model> x8])
pt = Point([<point referenced from the Rhino model> x11])
pt_2 = Point(Point(0, 0, 0))
move2pt = MoveToPoint(Geometry=geo, PointA=pt, PointB=pt_2)  # -> Moved, Vector, Transform
